# Dynamo graph Asset Placement System.dyn (Dynamo 2.4.1.6326)
# packages: Tucrail.Dynamo.Civil 1.0.0, Tucrail.Dynamo.AutoCAD 1.0.0

# group: Base Alignment Information [IN] Alignment Name/Profile Name/Stations/Document [OUT] Alignment/Profile/Stations/Document
current = Autodesk.AutoCAD.DynamoNodes.Document.Current()
document = CodeBlock(document_plug=current) { document_plug; }
alignment_name = CodeBlock { "Alignment - (1)"; }
alignmentByName = Autodesk.Civil.DynamoNodes.Selection.AlignmentByName(name=alignment_name, document=current)
alignment = CodeBlock(Alignment_plug=alignmentByName) { Alignment_plug; }
station_range = CodeBlock { 0; 1610; 100; }
range = Range(start=station_range.out0, end=station_range.out1, step=station_range.out2)
stations = CodeBlock(Stations_plug=range) { Stations_plug; }
porfile_name = CodeBlock { "Layout (1)"; }
profileByName = Autodesk.Civil.DynamoNodes.Alignment.ProfileByName(alignment=alignmentByName, name=porfile_name)
profile = CodeBlock(Profile_plug=profileByName) { Profile_plug; }

# group: Block Selection by Name [IN] Document/Block Name [OUT] Document/Block
document_2 = CodeBlock(document_plug=document) { document_plug; }
blocks = Autodesk.AutoCAD.DynamoNodes.Document.Blocks(document=document_2)
flatten = List.Flatten(list=blocks)
name = Autodesk.AutoCAD.DynamoNodes.Block.Name(block=blocks)
flatten_2 = List.Flatten(list=name)
block_name = CodeBlock { "3D Switch"; }
allIndicesOf = List.AllIndicesOf(list=flatten_2, item=block_name)
getItemAtIndex = List.GetItemAtIndex(list=flatten, index=allIndicesOf)
block = CodeBlock(Block_plug=getItemAtIndex) { Block_plug; }
document_3 = CodeBlock(document_plug=document_2) { document_plug; }

# group: Retrieve Position Parameters [IN] Alignment/Profile/Stations/Offset [OUT] CoordinateSystem/Elevation/Cant
alignment_2 = CodeBlock(Alignment_plug=alignment) { Alignment_plug; }
stations_2 = CodeBlock(Stations_plug=stations) { Stations_plug; }
offset_value = CodeBlock { 0; }
coordinateSystemByStationOffset = Autodesk.Civil.DynamoNodes.Alignment.CoordinateSystemByStationOffset(alignment=alignment_2, station=stations_2, offset=offset_value)
coordinateSystem = CodeBlock(CoordinateSystem_plug=coordinateSystemByStationOffset) { CoordinateSystem_plug; }
profile_2 = CodeBlock(Profile_plug=profile) { Profile_plug; }
elevationByStation = Autodesk.Civil.DynamoNodes.Profile.ElevationByStation(profile=profile_2, station=stations_2)
elevation = CodeBlock(Elevation_plug=elevationByStation) { Elevation_plug; }
getCantInfoAt = CivilAlignment.GetCantInfoAt(alignment=alignment_2, station=stations_2)
cant = CodeBlock(Cant_plug=getCantInfoAt.Cant) { Cant_plug; }

# group: Calculate Position and Direction [IN] CoordinateSystem/Elevation/Cant [OUT] Position/Direction
coordinateSystem_2 = CodeBlock(CoordinateSystem_plug=coordinateSystem) { CoordinateSystem_plug; }
origin = CoordinateSystem.Origin(coordinateSystem=coordinateSystem_2)
X = Point.X(point=origin)
Y = Point.Y(point=origin)
elevation_2 = CodeBlock(Elevation_plug=elevation) { Elevation_plug; }
cant_2 = CodeBlock(Cant_plug=cant) { Cant_plug; }
center_axis_elevation = CodeBlock(a=elevation_2, b=cant_2) { a+(b/2); }
byCoordinates = Point.ByCoordinates(x=X, y=Y, z=center_axis_elevation)
position = CodeBlock(Position_plug=byCoordinates) { Position_plug; }
n0_vector_rotation_axis = CodeBlock { Vector.ByCoordinates(1,0,0); Vector.ByCoordinates(0,0,1); }  # "0 Vector - Rotation Axis"
XAxis = CoordinateSystem.XAxis(coordinateSystem=coordinateSystem_2)
angleAboutAxis = Vector.AngleAboutAxis(vector=n0_vector_rotation_axis.out0, otherVector=XAxis, rotationAxis=n0_vector_rotation_axis.out1)
direction = CodeBlock(Direction_plug=angleAboutAxis) { Direction_plug; }

# group: Create Block Reference [IN] Block/Position and Direction/Layer/Document [OUT] CADDynamicBlock
block_2 = CodeBlock(Block_plug=block) { Block_plug; }
position_and_direction = CodeBlock(Position_plug=position, Direction_plug=direction) { Position_plug; Vector.ByCoordinates(0,0,1); Direction_plug; Vector.ByCoordinates(1,1,1); }
layer = CodeBlock { "0"; }
document_4 = CodeBlock(document_plug=document_3) { document_plug; }
modelSpace = Autodesk.AutoCAD.DynamoNodes.Document.ModelSpace(document=document_4)
create = Autodesk.AutoCAD.DynamoNodes.BlockReference.Create(sourceBlock=block_2, position=position_and_direction.Position_plug, normal=position_and_direction.out1, rotationDegrees=position_and_direction.Direction_plug, scaleFactors=position_and_direction.out3, layer=layer, block=modelSpace, lacing=Longest)
byConvertFromBlock = CadDynamicBlock.ByConvertFromBlock(dbr=create)
CADDynamicBlcok = CodeBlock(CADDynamicBlock_plug=byConvertFromBlock) { CADDynamicBlock_plug; }

# group: Cross slope calculation and rotation [IN] CADDynamicBlock/CoordinateSystem/Cant/Track Gauge [OUT] CADDynamicBlock
CADDynamicBlcok_2 = CodeBlock(CADDynamicBlock_plug=CADDynamicBlcok) { CADDynamicBlock_plug; }
coordinateSystem_3 = CodeBlock(CoordinateSystem_plug=coordinateSystem) { CoordinateSystem_plug; }
YAxis = CoordinateSystem.YAxis(coordinateSystem=coordinateSystem_3)
cant_3 = CodeBlock(Cant_plug=cant) { Cant_plug; }
track_gauge = CodeBlock { 1.435; }
cant_ratio = CodeBlock(a=cant_3, b=track_gauge) { a/b; }
atan = Math.Atan(ratio=cant_ratio)
byRotation = CadDynamicBlock.ByRotation(dynamicBlock=CADDynamicBlcok_2, normal=YAxis, degree=atan)

# group: Longitudinal slope calculation and rotation [IN] CADDynamicBlock/CoordinateSystem/Profile/Stations [OUT] CADDynamicBlock
CADDynamicBlcok_3 = CodeBlock(CADDynamicBlock_plug=byRotation) { CADDynamicBlock_plug; }
coordinateSystem_4 = CodeBlock(CoordinateSystem_plug=coordinateSystem) { CoordinateSystem_plug; }
XAxis_2 = CoordinateSystem.XAxis(coordinateSystem=coordinateSystem_4)
profile_3 = CodeBlock(Profile_plug=profile) { Profile_plug; }
stations_3 = CodeBlock(Stations_plug=stations) { Stations_plug; }
getGradeAt = CivilProfile.GetGradeAt(profile=profile_3, station=stations_3)
atan_2 = Math.Atan(ratio=getGradeAt)
byRotation_2 = CadDynamicBlock.ByRotation(dynamicBlock=CADDynamicBlcok_3, normal=XAxis_2, degree=atan_2)
