# Dynamo graph Corridor Automated Ruler.dyn (Dynamo 2.4.1.6326)

# group: Base Corridor Information [IN] Document/Corridor Name [OUT] Document/Baseline/Stations
corridor_name = CodeBlock { "Corridor - (1)"; }
current = Autodesk.AutoCAD.DynamoNodes.Document.Current()
document = CodeBlock(d=current) { d; }
corridorByName = Autodesk.Civil.DynamoNodes.Selection.CorridorByName(name=corridor_name, document=document)
baselines = Autodesk.Civil.DynamoNodes.Corridor.Baselines(corridor=corridorByName)
baseline = CodeBlock(Baseline_plug=baselines) { Baseline_plug; }
stations = Autodesk.Civil.DynamoNodes.Baseline.Stations(baseline=baselines)
flatten = List.Flatten(list=stations)
stations_2 = CodeBlock(Stations_plug=flatten) { Stations_plug; }
document_2 = CodeBlock(document_plug=document) { document_plug; }

# group: Change AppliedSubassembly Parameter [IN] Baseline/Stations/Station Zone/Parameter Edit [OUT] AppliedSubssembly
baseline_2 = CodeBlock(Baseline_plug=baseline) { Baseline_plug; }
stations_3 = CodeBlock(Stations_plug=stations_2) { Stations_plug; }
station_zone = CodeBlock { 70; 95; 1; }
slice = List.Slice(list=stations_3, start=station_zone.out0, end=station_zone.out1, step=station_zone.out2)
subassembliesByStation = Autodesk.Civil.DynamoNodes.Baseline.SubassembliesByStation(baseline=baseline_2, station=slice, lacing=Longest)
parameter_edit = CodeBlock { "Width"; "80"; "true"; }
setParameterByName = Autodesk.Civil.DynamoNodes.AppliedSubassembly.SetParameterByName(appliedSubassembly=subassembliesByStation, name=parameter_edit.out0, value=parameter_edit.out1, rebuild=parameter_edit.out2)

code_block = CodeBlock { 1000; }
pause = Thread.Pause(x=baseline, msTimeout=code_block)
pause_2 = Thread.Pause(x=stations_2, msTimeout=code_block)

# group: Measure between 2 Points [IN] Baseline/Stations/Point Code [OUT] Horizontal Distance/Table Data
baseline_3 = CodeBlock(Baseline_plug=pause) { Baseline_plug; }
baseline_4 = CodeBlock(Baseline_repeat=baseline_3) { Baseline_repeat; }
stations_4 = CodeBlock(Stations_plug=pause_2) { Stations_plug; }
point_code = CodeBlock { "RW_Top"; }
pointsByPointCodeAtNearestStation = Autodesk.Civil.DynamoNodes.Baseline.PointsByPointCodeAtNearestStation(baseline=baseline_3, station=stations_4, code=point_code, lacing=Longest)
flatten_2 = List.Flatten(list=pointsByPointCodeAtNearestStation.Points)
code_block_2 = CodeBlock { 2; 0; 1; }
dropEveryNthItem = List.DropEveryNthItem(list=flatten_2, n=code_block_2.out0, offset=code_block_2.out1)
stationOffsetByPoint = Autodesk.Civil.DynamoNodes.Baseline.StationOffsetByPoint(baseline=baseline_4, point=dropEveryNthItem, lacing=Longest)
flatten_3 = List.Flatten(list=pointsByPointCodeAtNearestStation.Points)
dropEveryNthItem_2 = List.DropEveryNthItem(list=flatten_3, n=code_block_2.out0, offset=code_block_2.out2)
stationOffsetByPoint_2 = Autodesk.Civil.DynamoNodes.Baseline.StationOffsetByPoint(baseline=baseline_4, point=dropEveryNthItem_2, lacing=Longest)
max = Math.Max(value1=stationOffsetByPoint.Offset, value2=stationOffsetByPoint_2.Offset)
min = Math.Min(value1=stationOffsetByPoint.Offset, value2=stationOffsetByPoint_2.Offset)
right_offset_left_offset = CodeBlock(a=max, b=min) { (a-b); }
abs = Math.Abs(number=right_offset_left_offset)
horizontal_distance = CodeBlock(HorizontalDist_plug=abs) { HorizontalDist_plug; }
stations_5 = CodeBlock(Stations_plug=stations_4) { Stations_plug; }
string_from_object = FromObject(obj=stations_5)
string_from_object_2 = FromObject(obj=abs)
max_2 = Math.Max(value1=stationOffsetByPoint.Elevation, value2=stationOffsetByPoint_2.Elevation)
min_2 = Math.Min(value1=stationOffsetByPoint.Elevation, value2=stationOffsetByPoint_2.Elevation)
max_min_elevation = CodeBlock(a=max_2, b=min_2) { (a-b); }
abs_2 = Math.Abs(number=max_min_elevation)
string_from_object_3 = FromObject(obj=abs_2)
list_create = List.Create(item0=string_from_object, item1=string_from_object_2, item2=string_from_object_3)
transpose = List.Transpose(lists=list_create)
table_data = CodeBlock(TableData_plug=transpose) { TableData_plug; }

# group: Evaluate Horizontal Distance [IN] Horizontal Distance/Evaluation Value [OUT] DataRowIndex
horizontal_distance_2 = CodeBlock(HorizontalDist_plug=horizontal_distance) { HorizontalDist_plug; }
evaluation_value = CodeBlock { 30; }
gt = horizontal_distance_2 > evaluation_value
boolean = BoolSelector(true)
allIndicesOf = List.AllIndicesOf(list=gt, item=boolean)
data_row_indexes = CodeBlock(DataRowIndex_plug=allIndicesOf) { DataRowIndex_plug; }

# group: Placement of indication objects [IN] Baseline/Stations/DataRowIndex/Circle Properties/Document [OUT] Circles
baseline_5 = CodeBlock(Baseline_plugin=baseline) { Baseline_plugin; }
stations_6 = CodeBlock(Stations_plug=stations_2) { Stations_plug; }
data_row_indexes_2 = CodeBlock(DataRowIndex_plug=data_row_indexes) { DataRowIndex_plug; }
getItemAtIndex = List.GetItemAtIndex(list=stations_6, index=data_row_indexes_2)
pointByStationOffsetElevation = Autodesk.Civil.DynamoNodes.Baseline.PointByStationOffsetElevation(baseline=baseline_5, station=getItemAtIndex, lacing=Longest)
circle_properties = CodeBlock { 5; "0"; }
circle_radius = CodeBlock(Radius=circle_properties.out0) { Radius; }
byCenterPointRadiusNormal = Circle.ByCenterPointRadiusNormal(centerPoint=pointByStationOffsetElevation, radius=circle_radius)
circle_layer = CodeBlock(Layer=circle_properties.out1) { Layer; }
document_3 = CodeBlock(document_plug=document_2) { document_plug; }
modelSpace = Autodesk.AutoCAD.DynamoNodes.Document.ModelSpace(document=document_3)
byGeometry = Autodesk.AutoCAD.DynamoNodes.Object.ByGeometry(geometry=byCenterPointRadiusNormal, layer=circle_layer, block=modelSpace)

# group: Create AutoCAD Table [IN] Document/Table Properties/Table Data [OUT] CADTable
document_4 = CodeBlock(document_plug=document_2) { document_plug; }
table_properties = CodeBlock { Point.ByCoordinates(6000,4250,0); "Corridor Analyses"; ["Station","Horizontal dif", "Vertical dif"]; 5; }
table_data_2 = CodeBlock(TableData_plug=table_data) { TableData_plug; }
create = CadTable.Create(document=document_4, insertPoint=table_properties.out0, title=table_properties.out1, columns=table_properties.out2, columnWidth=table_properties.out3, data=table_data_2)

# group: Formatting AutoCAD Table column [IN] CADTable/ColumnIndex/DataRowIndex/Color [OUT] CADTable
CADTable = CodeBlock(CADTable_plug=create) { CADTable_plug; }
column_index = CodeBlock { 1; }
data_row_indexes_3 = CodeBlock(DataRowIndex_plug=data_row_indexes) { DataRowIndex_plug; }
color_palette = ColorPalette({R: 0, G: 255, B: 255, A: 255})
red = Color.Red(color=color_palette)
green = Color.Green(color=color_palette)
blue = Color.Blue(color=color_palette)
formatColumn = CadTable.FormatColumn(table=CADTable, columnIndex=column_index, dataRowIndex=data_row_indexes_3, red=red, green=green, blue=blue)
