# Dynamo graph Corridor Parameter Analyzer.dyn (Dynamo 2.4.1.6326)
# packages: Tucrail.Dynamo.AutoCAD 1.0.0

# group: Base Corridor Information [IN] Document/Corridor Name [OUT] Document/Baseline/Stations
current = Autodesk.AutoCAD.DynamoNodes.Document.Current()
document = CodeBlock(d=current) { d; }
document_2 = CodeBlock(document_plug=document) { document_plug; }
corridor_name = CodeBlock { "Corridor - (1)"; }
corridorByName = Autodesk.Civil.DynamoNodes.Selection.CorridorByName(name=corridor_name, document=document)
baselines = Autodesk.Civil.DynamoNodes.Corridor.Baselines(corridor=corridorByName)
stations = Autodesk.Civil.DynamoNodes.Baseline.Stations(baseline=baselines)
flatten = List.Flatten(list=stations)
baseline = CodeBlock(Baseline_plug=baselines) { Baseline_plug; }
stations_2 = CodeBlock(Stations_plug=flatten) { Stations_plug; }

# group: Retrieve AppliedSubassembly by Name [IN] Baseline/Stations [OUT] AppliedSubassembly
baseline_2 = CodeBlock(Baseline_plug=baseline) { Baseline_plug; }
stations_3 = CodeBlock(Stations_plug=stations_2) { Stations_plug; }
subassembliesByStation = Autodesk.Civil.DynamoNodes.Baseline.SubassembliesByStation(baseline=baseline_2, station=stations_3, lacing=Longest)
flatten_2 = List.Flatten(list=subassembliesByStation)
name = Autodesk.Civil.DynamoNodes.AppliedSubassembly.Name(appliedSubassembly=subassembliesByStation, lacing=Shortest)
flatten_3 = List.Flatten(list=name)
subassembly_name = CodeBlock { "RightLaneSuperelevationAOR"; }
allIndicesOf = List.AllIndicesOf(list=flatten_3, item=subassembly_name)
getItemAtIndex = List.GetItemAtIndex(list=flatten_2, index=allIndicesOf)
appliedsubassemblies_by_name = CodeBlock(AppliedSubassemblies_plug=getItemAtIndex) { AppliedSubassemblies_plug; }

# group: Retrieve AppliedSubassembly Parameters by Name [IN] AppliedSubassembly/Parameter Name [OUT] AppliedSubassembly Parameter
appliedsubassemblies_by_name_2 = CodeBlock(AppliedSubassemblies_plug=appliedsubassemblies_by_name) { AppliedSubassemblies_plug; }
parameters = Autodesk.Civil.DynamoNodes.AppliedSubassembly.Parameters(appliedSubassembly=appliedsubassemblies_by_name_2)
flatten_4 = List.Flatten(list=parameters)
name_2 = Autodesk.Civil.DynamoNodes.SubassemblyParameter.Name(subassemblyParameter=parameters)
flatten_5 = List.Flatten(list=name_2)
parameter_name = CodeBlock { "Width"; }
allIndicesOf_2 = List.AllIndicesOf(list=flatten_5, item=parameter_name)
getItemAtIndex_2 = List.GetItemAtIndex(list=flatten_4, index=allIndicesOf_2)
parameter_by_name = CodeBlock(Parameter_plug=getItemAtIndex_2) { Parameter_plug; }

# group: Create Parameter Data List [IN] Stations/Parameter [OUT] Table Data
stations_4 = CodeBlock(Stations_plug=flatten) { Stations_plug; }
string_from_object = FromObject(obj=stations_4)
parameter_by_name_2 = CodeBlock(Parameter_plug=parameter_by_name) { Parameter_plug; }
name_3 = Autodesk.Civil.DynamoNodes.SubassemblyParameter.Name(subassemblyParameter=parameter_by_name_2@L1)
value = Autodesk.Civil.DynamoNodes.SubassemblyParameter.Value(subassemblyParameter=parameter_by_name_2)
string_from_object_2 = FromObject(obj=value)
list_create = List.Create(item0=string_from_object, item1=name_3, item2=string_from_object_2)
transpose = List.Transpose(lists=list_create)
table_data = CodeBlock(TableData_plug=transpose) { TableData_plug; }

# group: Create AutoCAD Table [IN] Document/Table Properties/Table Data [OUT] CADTable
document_3 = CodeBlock(document_plug=document_2) { document_plug; }
table_properties = CodeBlock { Point.ByCoordinates(6020,4250); "Corridor-Width"; ["Station","Name","Value"]; 5; }
table_data_2 = CodeBlock(TableData_plug=table_data) { TableData_plug; }
create = CadTable.Create(document=document_3, insertPoint=table_properties.out0, title=table_properties.out1, columns=table_properties.out2, columnWidth=table_properties.out3, data=table_data_2)
