# Dynamo graph Dynamo Data Extraction.dyn (Dynamo 2.4.1.6326)
# packages: Tucrail.Dynamo.AutoCAD 1.0.0

# group: Dynamo Data Extraction [IN] DXE File Path [OUT] Columns/Table Data/Object Handle
file_path = Filename(".\Dynamo Data Extraction.dxe")
getData = CadDataExtraction.GetData(dxeFile=file_path)
watch = Watch(getData.Columns)
columns = CodeBlock(Columns_plug=watch) { Columns_plug; }
watch_2 = Watch(getData.Data)
table_data = CodeBlock(TableData_plug=watch_2) { TableData_plug; }
watch_3 = Watch(getData.Handles)
object_handle = CodeBlock(ObjectHandle_plug=watch_3) { ObjectHandle_plug; }

# group: Create AutoCAD Table [IN] Document/Table Properties/Columns/Table Data [OUT] CADTable
current = Autodesk.AutoCAD.DynamoNodes.Document.Current()
code_block = CodeBlock { Point.ByCoordinates(4,180); "ExtractionTable"; 3; }
code_block_2 = CodeBlock(Columns_plug=columns) { Columns_plug; }
table_data_2 = CodeBlock(TableData_plug=table_data) { TableData_plug; }
create = CadTable.Create(document=current, insertPoint=code_block.out0, title=code_block.out1, columns=code_block_2, columnWidth=code_block.out2, data=table_data_2)

# group: Evaluate Radius Column [IN] Columns/Column Name/Table Data/Evaluation Value [OUT] Column Index/ Data Row Indices
columns_2 = CodeBlock(Columns_plug=columns) { Columns_plug; }
column_name = CodeBlock { "Radius"; }
indexOf = List.IndexOf(list=columns_2, element=column_name)
column_index = CodeBlock(ColumnIndex_plug=indexOf) { ColumnIndex_plug; }
table_data_3 = CodeBlock(TableData_plug=table_data) { TableData_plug; }
getItemAtIndex = List.GetItemAtIndex(list=table_data_3@L2, index=indexOf)
toNumber = String.ToNumber(str=getItemAtIndex)
evaluation_value = CodeBlock { 19; }
equals = List.Equals(objectA=toNumber, objectB=evaluation_value, lacing=Longest)
boolean = BoolSelector(true)
allIndicesOf = List.AllIndicesOf(list=equals, item=boolean)
data_row_indices = CodeBlock(DataRowIndices_plug=allIndicesOf) { DataRowIndices_plug; }

# group: Formatting AutoCAD Table column and AutoCAD Object [IN] CADTable/Column Index/DataRowIndex/Color/Document/Object Handle [OUT] Boolean
cad_table = CodeBlock(CadTable_plug=create) { CadTable_plug; }
column_index_2 = CodeBlock(ColumnIndex_plug=column_index) { ColumnIndex_plug; }
data_row_indices_2 = CodeBlock(DataRowIndices_plug=data_row_indices) { DataRowIndices_plug; }
color_palette = ColorPalette({R: 255, G: 0, B: 0, A: 255})
red = Color.Red(color=color_palette)
green = Color.Green(color=color_palette)
blue = Color.Blue(color=color_palette)
formatColumn = CadTable.FormatColumn(table=cad_table, columnIndex=column_index_2, dataRowIndex=data_row_indices_2, red=red, green=green, blue=blue)
current_2 = Autodesk.AutoCAD.DynamoNodes.Document.Current()
object_handle_2 = CodeBlock(ObjectHandle_plug=object_handle) { ObjectHandle_plug; }
getItemAtIndex_2 = List.GetItemAtIndex(list=object_handle_2, index=data_row_indices_2)
setColor = CadObject.SetColor(document=current_2, handle=getItemAtIndex_2, red=red, green=green, blue=blue)
