# Dynamo graph Switch Profile.dyn (Dynamo 2.4.1.6326)
# packages: Tucrail.Dynamo.AutoCAD 1.0.0, Tucrail.Dynamo.Civil 1.0.0

# group: Base Block Information [IN] Block Name/Document [OUT] CADDynamicBlock/Document
current = Autodesk.AutoCAD.DynamoNodes.Document.Current()
block_name = CodeBlock { "Switch Data Management"; }
getDynamicBlockReferences = CadDynamicBlock.GetDynamicBlockReferences(document=current, blockName=block_name)
document = CodeBlock(document_plug=current) { document_plug; }

# group: Retrieve Dynamic Block data [IN] Document/CADDynamicBlock/Block Attributes [OUT] Alignement/Asset Name/Points
CADDynamicBlock = CodeBlock(CADDynamicBlock_plug=getDynamicBlockReferences) { CADDynamicBlock_plug; }
block_attributes = CodeBlock { "NAME"; "ALIGNMENT"; ["POINT0","POINT1","POINT2","POINT3"]; }
getAttributeValue = CadDynamicBlock.GetAttributeValue(dynamicBlock=CADDynamicBlock, attributeName=block_attributes.out1)
document_2 = CodeBlock(document_plug=document) { document_plug; }
alignmentByName = Autodesk.Civil.DynamoNodes.Selection.AlignmentByName(name=getAttributeValue, document=document_2)
alignment = CodeBlock(Alignment_plug=alignmentByName) { Alignment_plug; }
getAttributeValue_2 = CadDynamicBlock.GetAttributeValue(dynamicBlock=CADDynamicBlock, attributeName=block_attributes.out2, lacing=CrossProduct)
code_block = CodeBlock { ","; }
split = String.Split(str=getAttributeValue_2, separator0=code_block)
toNumber = String.ToNumber(str=split)
code_block_2 = CodeBlock { 0; 1; 2; }
getItemAtIndex = List.GetItemAtIndex(list=toNumber@L2, index=code_block_2.out0)
code_block_3 = CodeBlock { 4; }
chop = List.Chop(list=getItemAtIndex, lengths=code_block_3)
getItemAtIndex_2 = List.GetItemAtIndex(list=toNumber@L2, index=code_block_2.out1)
chop_2 = List.Chop(list=getItemAtIndex_2, lengths=code_block_3)
getItemAtIndex_3 = List.GetItemAtIndex(list=toNumber@L2, index=code_block_2.out2)
chop_3 = List.Chop(list=getItemAtIndex_3, lengths=code_block_3)
byCoordinates = Point.ByCoordinates(x=chop, y=chop_2, z=chop_3)
getAttributeValue_3 = CadDynamicBlock.GetAttributeValue(dynamicBlock=CADDynamicBlock, attributeName=block_attributes.out0)
asset_name = CodeBlock(AssetName_plug=getAttributeValue_3) { AssetName_plug; }

# group: Point1-2-3 StationOffset [IN] Alignment/Point [OUT] Point 1-2-3 Station-Offset
stationOffsetByPoint = Autodesk.Civil.DynamoNodes.Alignment.StationOffsetByPoint(alignment=alignment, point=byCoordinates)
point_number = CodeBlock { 1; 2; 3; }
getItemAtIndex_4 = List.GetItemAtIndex(list=stationOffsetByPoint.Offset@L2, index=point_number.out0)
point_1_offset = CodeBlock(Point1Offset_plug=getItemAtIndex_4) { Point1Offset_plug; }
getItemAtIndex_5 = List.GetItemAtIndex(list=stationOffsetByPoint.Station@L2, index=point_number.out0, lacing=Longest)
point_1_station = CodeBlock(Point1Station_plug=getItemAtIndex_5) { Point1Station_plug; }
getItemAtIndex_6 = List.GetItemAtIndex(list=stationOffsetByPoint.Station@L2, index=point_number.out1)
point_2_station = CodeBlock(Point2Station_plug=getItemAtIndex_6) { Point2Station_plug; }
getItemAtIndex_7 = List.GetItemAtIndex(list=stationOffsetByPoint.Offset@L2, index=point_number.out1)
point_2_offset = CodeBlock(Point2Offset_plug=getItemAtIndex_7) { Point2Offset_plug; }
getItemAtIndex_8 = List.GetItemAtIndex(list=stationOffsetByPoint.Offset@L2, index=point_number.out2)
point_3_offset = CodeBlock(Point3Offset_plug=getItemAtIndex_8) { Point3Offset_plug; }
getItemAtIndex_9 = List.GetItemAtIndex(list=stationOffsetByPoint.Station@L2, index=point_number.out2)
point_3_station = CodeBlock(Point3Station_plug=getItemAtIndex_9) { Point3Station_plug; }

# group: Asset Relative Position part 1 [IN] Point1Station/Point2Station/Point2Offset/Point3Offset [OUT] UpIndicator/MainIndicator/Point2OffsetNegative/Point3OffsetNegative
point_1_station_2 = CodeBlock(Point1Station_plug=point_1_station) { Point1Station_plug; }
point_2_station_2 = CodeBlock(Point2Station_plug=point_2_station) { Point2Station_plug; }
gt = point_1_station_2 > point_2_station_2  # lacing=Shortest
up_indicator = CodeBlock(UpIndicator_plug=gt) { UpIndicator_plug; }
point_2_offset_2 = CodeBlock(Point2Offset_plug=point_2_offset) { Point2Offset_plug; }
code_block_4 = CodeBlock { 3; }
round = Math.Round(number=point_2_offset_2, digits=code_block_4)
code_block_5 = CodeBlock { 0; }
eq = round == code_block_5
main_indicator = CodeBlock(MainIndicator_plug=eq) { MainIndicator_plug; }
point_3_offset_2 = CodeBlock(Point3Offset_plug=point_3_offset) { Point3Offset_plug; }
round_2 = Math.Round(number=point_3_offset_2, digits=code_block_4)
lt = round_2 < code_block_5
point_3_offset_negative = CodeBlock(Point3OffsetNegative_plug=lt) { Point3OffsetNegative_plug; }
lt_2 = round < code_block_5
point_2_offset_negative = CodeBlock(Point2OffsetNegative_plug=lt_2) { Point2OffsetNegative_plug; }

# group: Asset Relative Position part 2 [IN] UpIndicator/MainIndicator/Point2OffsetNegativeIndicator/Point3NegativeIndicator [OUT] UpDownCode/MainBranchCode/MainRightIndicator/BranchRightIndicator
up_indicator_2 = CodeBlock(UpIndicator_plug=up_indicator) { UpIndicator_plug; }
code_block_6 = CodeBlock { "Up"; "Down"; }
if_ = If(test=up_indicator_2, true=code_block_6.out0, false=code_block_6.out1)
up_down_code = CodeBlock(UpDownCode_plug=if_) { UpDownCode_plug; }
main_indicator_2 = CodeBlock(MainIndicator_plug=main_indicator) { MainIndicator_plug; }
code_block_7 = CodeBlock { "Main"; "Branch"; }
if_2 = If(test=main_indicator_2, true=code_block_7.out0, false=code_block_7.out1)
main_branch_code = CodeBlock(MainBranchCode_plug=if_2) { MainBranchCode_plug; }
code_block_8 = CodeBlock { [[0,1],[1,0]]; }
code_block_9 = CodeBlock { 0; 1; }
if_3 = If(test=up_indicator_2, true=code_block_9.out0, false=code_block_9.out1)
code_block_10 = CodeBlock(a=code_block_8, b=if_3) { a[b]; }
point_3_offset_negative_2 = CodeBlock(Point3OffsetNegative_plug=point_3_offset_negative) { Point3OffsetNegative_plug; }
if_4 = If(test=point_3_offset_negative_2, true=code_block_9.out0, false=code_block_9.out1)
getItemAtIndex_10 = List.GetItemAtIndex(list=code_block_10@L2, index=if_4, lacing=Shortest)
code_block_11 = CodeBlock { "Right"; "Left"; }
if_5 = If(test=getItemAtIndex_10, true=code_block_11.out1, false=code_block_11.out0)
main_right_indicator = CodeBlock(MainRightIndicator_plug=if_5) { MainRightIndicator_plug; }
code_block_12 = CodeBlock { [[1,0],[0,1]]; }
code_block_13 = CodeBlock { 0; 1; }
if_6 = If(test=up_indicator_2, true=code_block_13.out0, false=code_block_13.out1)
code_block_14 = CodeBlock(a=code_block_12, b=if_6) { a[b]; }
point_2_offset_negative_2 = CodeBlock(Point2OffsetNegative_plug=point_2_offset_negative) { Point2OffsetNegative_plug; }
if_7 = If(test=point_2_offset_negative_2, true=code_block_13.out0, false=code_block_13.out1)
getItemAtIndex_11 = List.GetItemAtIndex(list=code_block_14@L2, index=if_7, lacing=Shortest)
code_block_15 = CodeBlock { "Right"; "Left"; }
if_8 = If(test=getItemAtIndex_11, true=code_block_15.out1, false=code_block_15.out0)
branch_right_indicator = CodeBlock(BranchRightIndicator_plug=if_8) { BranchRightIndicator_plug; }

# group: Create Profile Description [IN] UPDownCode/MainBranchCode/MainRightIndicator/BranchRightIndicator [OUT] AssetDescription
separator = CodeBlock { "-"; }
up_down_code_2 = CodeBlock(UpDownCode_plug=up_down_code) { UpDownCode_plug; }
main_branch_code_2 = CodeBlock(MainBranchCode_plug=main_branch_code) { MainBranchCode_plug; }
main_code = CodeBlock { "Main"; }
eq_2 = main_branch_code_2 == main_code
main_right_indicator_2 = CodeBlock(MainRightIndicator_plug=main_right_indicator) { MainRightIndicator_plug; }
branch_right_indicator_2 = CodeBlock(BranchRightIndicator_plug=branch_right_indicator) { BranchRightIndicator_plug; }
if_9 = If(test=eq_2, true=main_right_indicator_2, false=branch_right_indicator_2)
list_create = List.Create(item0=up_down_code_2, item1=main_branch_code_2, item2=if_9)
transpose = List.Transpose(lists=list_create)
join = String.Join(separator=separator, string0=transpose, lacing=CrossProduct)
flatten = List.Flatten(list=join)
asset_description = CodeBlock(AssetDescripsion_plug=flatten) { AssetDescripsion_plug; }

# group: Asset Start-End Station [IN] Point1Station/Point2Station/Point3Station/UpIndicator/MainIndicator [OUT] AssetStartStation/AssetEndStation
up_indicator_3 = CodeBlock(UpIndicator_plug=up_indicator) { UpIndicator_plug; }
main_indicator_3 = CodeBlock(MainIndicator_plug=main_indicator) { MainIndicator_plug; }
point_2_station_3 = CodeBlock(Point2Station_plug=point_2_station) { Point2Station_plug; }
point_3_station_2 = CodeBlock(Point3Station_plug=point_3_station) { Point3Station_plug; }
if_main_branch = If(test=main_indicator_3, true=point_2_station_3, false=point_3_station_2)
point_1_station_3 = CodeBlock(Point1Station_plug=point_1_station) { Point1Station_plug; }
if_start_station = If(test=up_indicator_3, true=if_main_branch, false=point_1_station_3)
asset_startstation = CodeBlock(AssetStartStation_plug=if_start_station) { AssetStartStation_plug; }
if_end_station = If(test=up_indicator_3, true=point_1_station_3, false=if_main_branch)
asset_endstation = CodeBlock(AssetEndStation_plug=if_end_station) { AssetEndStation_plug; }

# group: Create Asset Profile [IN] Alignment Name/Profile Properties/Asset Properties/Document [OUT] Profile
asset_properties = CodeBlock(AssetName_plug=asset_name, AssetDescription_plug=asset_description, AssetStartStation_plug=asset_startstation, AssetEndStation_plug=asset_endstation) { AssetName_plug; AssetDescription_plug; AssetStartStation_plug; AssetEndStation_plug; }
alignment_2 = CodeBlock(Alignment_plug=alignment) { Alignment_plug; }
profile_properties = CodeBlock { "Layout (1)"; "0"; "Basic"; "ProfileLabel"; "Switch Label Set"; }
profileByName = Autodesk.Civil.DynamoNodes.Alignment.ProfileByName(alignment=alignment_2, name=profile_properties.out0)
document_3 = CodeBlock(document_plug=document) { document_plug; }
getLayerId = CivilObjectId.GetLayerId(document=document_3, layerName=profile_properties.out1)
getProfileStyleId = CivilObjectId.GetProfileStyleId(document=document_3, styleName=profile_properties.out2)
getLabelSetStyleId = CivilObjectId.GetLabelSetStyleId(document=document_3, type=profile_properties.out3, styleName=profile_properties.out4)
createFromAsset = CivilProfile.CreateFromAsset(assetName=asset_properties.AssetName_plug, assetDescription=asset_properties.AssetDescription_plug, assetStartStation=asset_properties.AssetStartStation_plug, assetEndStation=asset_properties.AssetEndStation_plug, dynProfile=profileByName, layerId=getLayerId, styleId=getProfileStyleId, labelSetId=getLabelSetStyleId, document=document_3)
